# Dynamo graph evacuation_node_coordinate_extraction.dyn (Dynamo 3.0.3.7597)

categories = Categories("OST_Rooms")
all_elements_of_category = ElementsOfCategory(Category=categories)
getLocation = Element.GetLocation(element=all_elements_of_category)
X = Point.X(point=getLocation)
list_create = List.Create(item0=X)
Y = Point.Y(point=getLocation)
list_create_2 = List.Create(item0=Y)
categories_2 = Categories("OST_Doors")
all_elements_of_category_2 = ElementsOfCategory(Category=categories_2)
getLocation_2 = Element.GetLocation(element=all_elements_of_category_2)
X_2 = Point.X(point=getLocation_2)
list_create_3 = List.Create(item0=X_2)
Y_2 = Point.Y(point=getLocation_2)
list_create_4 = List.Create(item0=Y_2)
